# Grasshopper definition Laser_Cutting_Dome.gh (Grasshopper 1.0.7)

x_coordinate = Slider(0, range=0..100)
y_coordinate = Slider(2, range=0..100)
z_coordinate = Slider(25, range=0..100)
x_coordinate_2 = Slider(14, range=0..100)
y_coordinate_2 = Slider(4, range=0..100)
z_coordinate_2 = Slider(14, range=0..100)
height = Slider(0, range=0..50)
number_slider = Slider(39, range=0..100)
construct_point = ConstructPoint(XCoordinate=x_coordinate, YCoordinate=y_coordinate, ZCoordinate=z_coordinate)
construct_point_2 = ConstructPoint(XCoordinate=x_coordinate_2, YCoordinate=y_coordinate_2, ZCoordinate=z_coordinate_2)
line = Line(Line((0.1086829154, 0, 0.1086829154), (0.1086829154, 0, 21.41053433)))
point = Point(construct_point_2)
point_2 = Point(construct_point)
perp_frames = PerpFrames(Curve=line, Count=number_slider, Align=True)  # -> Frames, Parameters
division = Division(A=Slider(10, range=0..10), B=number_slider)
metaball_t_custom = MetaBallTCustom(
    Points=[point_2, point],
    Charge=[Slider(43.05, range=0..100), Slider(20.95, range=0..100)],
    Plane=perp_frames.Frames,
    Threshold=0.5)
panel = Panel(division)
