# Grasshopper definition Space_Syntax_AxialMap_Line_Extender.gh (Grasshopper 1.0.7)

side_1 = Slider(1, range=0..1)
curve = Curve([<curve referenced from the Rhino model> x8])
side_2 = Slider(0, range=0..1)
evaluate_curve = EvaluateCurve(Curve=reparameterize(curve), Parameter=side_1)  # -> Point, Tangent, Angle
extending_length = Slider(16, range=0..100)
evaluate_curve_2 = EvaluateCurve(Curve=reparameterize(curve), Parameter=side_2)  # -> Point, Tangent, Angle
negative = Negative(Value=evaluate_curve_2.Tangent)
multiplication = Multiplication(A=negative, B=extending_length)
multiplication_2 = Multiplication(A=evaluate_curve.Tangent, B=extending_length)
move = Move(Geometry=evaluate_curve.Point, Motion=multiplication_2)  # -> Geometry, Transform
move_2 = Move(Geometry=evaluate_curve_2.Point, Motion=multiplication)  # -> Geometry, Transform
line = Line(StartPoint=move.Geometry, EndPoint=move_2.Geometry)
